# Grasshopper definition Fluid by Field_01.gh (Grasshopper 0.9.76)

charge_point = Point([<point referenced from the Rhino model> x4])
spin_point = Point(<point referenced from the Rhino model>)
box = Box({Plane=PlaneXY(0, 0, 0), X=Domain(0, 20), Y=Domain(0, 20), Z=Domain(0, 1)})
spin_force = SpinForce(Plane=spin_point, Strength=1, Radius=5, Decay=2, Bounds=box)
point_charge = PointCharge(Point=charge_point, Charge=1, Decay=2)
panel = Panel(spin_force)
list_length = ListLength(List=spin_force)
domain = Domain(Domain(6, 10))
random = Random(Range=domain, Number=list_length, Seed=Slider(25, range=0..100))
