# Grasshopper definition Fluid by Field_02.gh (Grasshopper 0.9.76)

md_slider = MDSlider(slider_value=Point(0.5, 0.5, 0.5), SliderMode=0, x_domain=Domain(0, 3), y_domain=Domain(0, 3), z_domain=Domain(0, 1))
md_slider_2 = MDSlider(slider_value=Point(0.5, 0.5, 0.5), SliderMode=0, x_domain=Domain(0, 3), y_domain=Domain(0, 3), z_domain=Domain(0, 1))
charge_point = Point([<point referenced from the Rhino model> x8])
spin_point = Point([<point referenced from the Rhino model> x4])
list_length = ListLength(List=spin_point)
domain = Domain(Domain(6, 10))
list_length_2 = ListLength(List=charge_point)
domain_2 = Domain(Domain(6, 10))
line = Line(StartPoint=md_slider, EndPoint=md_slider_2)
random = Random(Range=domain, Number=list_length, Seed=Slider(25, range=0..100))
random_2 = Random(Range=domain_2, Number=list_length_2, Seed=Slider(45, range=0..100))
box = Box({Plane=PlaneXY(0, 0, 0), X=Domain(0, 20), Y=Domain(0, 20), Z=Domain(0, 1)})
spin_force = SpinForce(Plane=spin_point, Strength=random, Radius=5, Decay=2, Bounds=box)
vector_force = VectorForce(Line=line, Bounds=box)
point_charge = PointCharge(Point=charge_point, Charge=random_2, Decay=2, Bounds=box)
merge = Merge(Data1=[point_charge, spin_force, vector_force])
