# Grasshopper definition Fluid by Field_03.gh (Grasshopper 0.9.76)

md_slider = MDSlider(slider_value=Point(0, 0, 0.5), SliderMode=0, x_domain=Domain(0, 3), y_domain=Domain(0, 3), z_domain=Domain(0, 1))
md_slider_2 = MDSlider(slider_value=Point(0.5, 0.5, 0.5), SliderMode=0, x_domain=Domain(0, 3), y_domain=Domain(0, 3), z_domain=Domain(0, 1))
charge_point = Point([<point referenced from the Rhino model> x8])
spin_point = Point([<point referenced from the Rhino model> x4])
list_length = ListLength(List=spin_point)
domain = Domain(Domain(6, 10))
list_length_2 = ListLength(List=charge_point)
domain_2 = Domain(Domain(6, 10))
domain_3 = Domain(Domain(0, 20))
line = Line(StartPoint=md_slider, EndPoint=md_slider_2)
random = Random(Range=domain, Number=list_length, Seed=Slider(25, range=0..100))
random_2 = Random(Range=domain_2, Number=list_length_2, Seed=Slider(45, range=0..100))
range = Range(Domain=domain_3, Steps=Slider(80, range=0..100))
box = Box({Plane=PlaneXY(0, 0, 0), X=Domain(0, 20), Y=Domain(0, 20), Z=Domain(0, 1)})
circle = Circle(Plane=charge_point, Radius=1)
spin_force = SpinForce(Plane=spin_point, Strength=random, Radius=5, Decay=2, Bounds=box)
construct_point = ConstructPoint(XCoordinate=graft(range), YCoordinate=range, ZCoordinate=0)
vector_force = VectorForce(Line=line, Bounds=box)
point_charge = PointCharge(Point=charge_point, Charge=random_2, Decay=2, Bounds=box)
divide_curve = DivideCurve(Curve=circle, Count=Slider(20, range=0..100), Kinks=False)  # -> Points, Tangents, Parameters
sample_points = Point(flatten([divide_curve.Points, construct_point]))
merge_fields = MergeFields(Fields=flatten([spin_force, point_charge, vector_force]))
field_line = FieldLine(Field=merge_fields, Point=sample_points, Steps=1000, Accuracy=0.1, Method=3)
evaluate_field = EvaluateField(Field=merge_fields, Point=sample_points)  # -> Tensor, Strength
direction_display = DirectionDisplay(
    Field=merge_fields,
    Section={Plane=PlaneXY(-0.4138434737, -0.4138434737, 0), Size=Domain2(u=0..20.82768695, v=0..20.82768695)},
    Samples=5000)
scalar_display = ScalarDisplay(
    Field=merge_fields,
    Section={Plane=PlaneXY(-0.4138434737, -0.4138434737, 0), Size=Domain2(u=0..20.82768695, v=0..20.82768695)},
    Samples=8000)
tensor_display = TensorDisplay(
    Field=merge_fields,
    Section={Plane=PlaneXY(-0.4138434737, -0.4138434737, 0), Size=Domain2(u=0..20.82768695, v=0..20.82768695)},
    Samples=1000)

# ---- group: 设置极限
smaller_than = SmallerThan(FirstNumber=evaluate_field.Strength, SecondNumber=Slider(7, range=0..100))  # -> SmallerThan, OrEqualTo
cull_pattern = CullPattern(List=evaluate_field.Strength, CullPattern=smaller_than.SmallerThan)

# ---- group: 作为查看，不参与计算
sort_list = SortList(Keys=evaluate_field.Strength)  # -> Keys, ValuesValuesA
bounds = Bounds(Numbers=evaluate_field.Strength)
panel = Panel(sort_list.Keys)
panel_2 = Panel(bounds)

# ----
bounds_2 = Bounds(Numbers=cull_pattern)
deconstruct_domain = DeconstructDomain(Domain=bounds_2)  # -> Start, End
gradient = Gradient(
    LowerLimit=deconstruct_domain.Start,
    UpperLimit=deconstruct_domain.End,
    Parameter=evaluate_field.Strength,
    stops=[0: RGB(234, 38, 0), 0.204: RGB(234, 126, 0), 0.498: RGB(254, 244, 84), 0.75: RGB(173, 203, 249), 1: RGB(75, 107, 169)])
custom_preview = CustomPreview(Geometry=field_line, Shader=gradient)
